# Grasshopper definition Elypse.gh (Grasshopper 1.0.8)

# ----
# http://mathworld.wolfram.com/Ellipse.html
image = ImageSampler(Filter="Colour", Interpolate=False, Umax=1, Umin=0, Vmax=1, Vmin=0, Wrap=0)

# ----
# Elypse
number_slider = Slider(16, range=0..20)
number_slider_2 = Slider(8.519, range=0..20)
number_slider_3 = Slider(12.832, range=0..20)
# 01
# Geometry
# Draw an elipsoid? based on the intersection of cicles
pt = Point(Point(30.86577451, 35.4097792, 0))
eval = Evaluate(F="((x-y)²-z²)/((x-y)*2)", x=number_slider, y=number_slider_2, z=number_slider_3)
expression = Expression(x=number_slider_3, Expression="-x")
expression_2 = Expression(x=eval, Expression="-x")
expression_3 = Expression(x=eval, Expression="-x")
X = UnitX(Factor=number_slider_3)
X_2 = UnitX(Factor=expression)
Y = UnitY(Factor=eval)
Y_2 = UnitY(Factor=expression_2)
move = Move(Geometry=pt, Motion=X)  # -> Geometry, Transform
move_2 = Move(Geometry=pt, Motion=X_2)  # -> Geometry, Transform
move_3 = Move(Geometry=pt, Motion=Y)  # -> Geometry, Transform
move_4 = Move(Geometry=pt, Motion=Y_2)  # -> Geometry, Transform
addition = Addition(A=number_slider, B=expression_3)
circle = CircleCNR(Center=pt, Normal=Vector(0, 0, 1), Radius=number_slider)
circle_2 = CircleCNR(Center=move.Geometry, Normal=Vector(0, 0, 1), Radius=number_slider_2)
circle_3 = CircleCNR(Center=move_2.Geometry, Normal=Vector(0, 0, 1), Radius=number_slider_2)
circle_4 = CircleCNR(Center=move_3.Geometry, Normal=Vector(0, 0, 1), Radius=addition)
circle_5 = CircleCNR(Center=move_4.Geometry, Normal=Vector(0, 0, 1), Radius=addition)
ccx = CurveCurve(CurveA=circle_2, CurveB=circle_4)  # -> Points, ParamsA, ParamsB
ccx_2 = CurveCurve(CurveA=circle_2, CurveB=circle_5)  # -> Points, ParamsA, ParamsB
ccx_3 = CurveCurve(CurveA=circle_3, CurveB=circle_4)  # -> Points, ParamsA, ParamsB
ccx_4 = CurveCurve(CurveA=circle_3, CurveB=circle_5)  # -> Points, ParamsA, ParamsB
shatter = Shatter(Curve=circle_2, Parameters=[ccx.ParamsA, ccx_2.ParamsA])
shatter_2 = Shatter(Curve=circle_3, Parameters=[ccx_3.ParamsA, ccx_4.ParamsA])
shatter_3 = Shatter(Curve=circle_4, Parameters=[ccx.ParamsB, ccx_3.ParamsB])
shatter_4 = Shatter(Curve=circle_5, Parameters=[ccx_2.ParamsB, ccx_4.ParamsB])
item = ListItem(List=shatter, Index="1", Wrap=True)
item_2 = ListItem(List=shatter_2, Index="0", Wrap=True)
item_3 = ListItem(List=shatter_3, Index="0", Wrap=True)
item_4 = ListItem(List=shatter_4, Index="0", Wrap=True)
join = JoinCurves(Curves=[item, item_2, item_3, item_4], Preserve=False)

# ----
# it appers that the expression editor does not differentiate case values of the same letter
number_slider_4 = Slider(4.8, range=0..20)
number_slider_5 = Slider(16, range=0..20)
number_slider_6 = Slider(15, range=0..20)
expression_4 = Expression(x=number_slider_6, y=number_slider_4, z=number_slider_5, Expression="((x-y)²-z²)/((x-y)*2)")
expression_5 = Expression(R=number_slider_6, r=number_slider_4, a=number_slider_5, Expression="((R-r)²-a²)/((R-r)*2)")

curve = Curve(join)
