# Grasshopper definition COBE tampere-travel-service-center.gh (Grasshopper 1.0.8)

# COBE Train Station
panel = Panel("Units in meters")

# ----
# Size of Grid
number_slider = Slider(6, range=0..20)

# ----
# Extent of Grid
number_slider_2 = Slider(24, range=0..50)
number_slider_3 = Slider(18, range=0..50)

# ----
# Roof Height
number_slider_4 = Slider(22, range=0..100)

# ----
# Create Roof Grid
construct_point = ConstructPoint(XCoordinate=0, YCoordinate=0, ZCoordinate=number_slider_4)
xy_plane = XYPlane(Origin=construct_point)

# ----
# Create Column Grid
multiplication = Multiplication(A=number_slider, B=number_slider)
division = Division(A=number_slider_2, B=number_slider)
division_2 = Division(A=number_slider_3, B=number_slider)
rectangular = Rectangular(Plane=xy_plane, SizeX=multiplication, SizeY=multiplication, ExtentX=division, ExtentY=division_2)  # -> Cells, Points

# ----
# Perimeter Overhang
number_slider_5 = Slider(2, range=0..100)

construct_point_2 = ConstructPoint(XCoordinate=0, YCoordinate=0, ZCoordinate=number_slider_4)
multiplication_2 = Multiplication(A=number_slider, B=number_slider_3)
multiplication_3 = Multiplication(A=number_slider, B=number_slider_2)
multiplication_4 = Multiplication(A=number_slider, B=number_slider_5)
xy_plane_2 = XYPlane(Origin=construct_point_2)
rectangle = Rectangle(Plane=xy_plane_2, XSize=multiplication_3, YSize=multiplication_2, Radius=0)  # -> Rectangle, Length
offset_curve = OffsetCurve(Curve=rectangle.Rectangle, Distance=multiplication_4, Plane=PlaneXY(0, 0, 0), Corners=1)
explode = Explode(Curve=rectangle.Rectangle, Recursive=True)  # -> Segments, Vertices
list_item = ListItem(List=explode.Segments, Index="1", Wrap="False")
list_item_2 = ListItem(List=explode.Segments, Index="0", Wrap="False")
perp_frames = PerpFrames(Curve=list_item, Count=Slider(3, range=0..10), Align=True)  # -> Frames, Parameters
perp_frames_2 = PerpFrames(Curve=list_item_2, Count=Slider(4, range=0..10), Align=True)  # -> Frames, Parameters
list_length = ListLength(List=perp_frames.Frames)
list_length_2 = ListLength(List=perp_frames_2.Frames)
expression = Expression(x=list_length, Expression="x - 1")
expression_2 = Expression(x=list_length_2, Expression="x - 1")

# ----
# Column Divisions
number_slider_6 = Slider(18, range=0..100)

# ----
# Create Column Divisions
curve = Curve(rectangular.Cells)
polygon_center = PolygonCenter(Polyline=curve)  # -> CenterV, CenterE, CenterA
project = Project(Geometry=polygon_center.CenterV, Plane=PlaneXY(0, 0, 0))  # -> Geometry, Transform
line = Line(StartPoint=polygon_center.CenterV, EndPoint=project.Geometry)
divide_curve = DivideCurve(Curve=line, Count=number_slider_6, Kinks=False)  # -> Points, Tangents, Parameters

merge = Merge(Data1="0", Data2=expression)  # -> flatten(Result)
merge_2 = Merge(Data1="0", Data2=expression_2)  # -> flatten(Result)
cull_index = CullIndex(List=perp_frames.Frames, Indices=merge, Wrap=True)
cull_index_2 = CullIndex(List=perp_frames_2.Frames, Indices=merge_2, Wrap=True)
merge_3 = Merge(Data1=cull_index_2, Data2=cull_index)  # -> flatten(Result)

# ----
# Column Base Radius
# Column Top Radius
number_slider_7 = Slider(15, range=0..100)

# ----
# Create Column Divisions
point = Point(divide_curve.Points)
list_length_3 = ListLength(List=point)
range = Range(Domain=Domain(0, 1), Steps=list_length_3)
construct_domain = ConstructDomain(DomainStart=Slider(1, range=0..3), DomainEnd=number_slider_7)
graph_mapper = GraphMapper(range, x0=0, x1=1, y0=0, y1=1, container_name="Bezier", cpx=[0, 0.5771749616, 1, 1], cpy=[0, 0, 0, 1])
remap_numbers = RemapNumbers(Value=graph_mapper, Source=Domain(0, 1), Target=construct_domain)  # -> Mapped, Clipped
unit_z = UnitZ(Factor=1)
reverse_list = ReverseList(List=remap_numbers.Mapped)
circle_cnr = CircleCNR(Center=point, Normal=unit_z, Radius=reverse_list)

brep_plane = BrepPlane(Brep=offset_curve, Plane=merge_3)  # -> flatten(Curves), Points
# Create Roof Purlins
curve_2 = Curve(rectangular.Cells)
polygon_center_2 = PolygonCenter(Polyline=curve_2)  # -> CenterV, CenterE, CenterA
surface_split = SurfaceSplit(Surface=offset_curve, Curves=brep_plane.Curves)
circle_cnr_2 = CircleCNR(Center=polygon_center_2.CenterV, Normal=Vector(0, 0, 1), Radius=number_slider_7)
deconstruct_brep = DeconstructBrep(Brep=surface_split)  # -> Faces, Edges, Vertices
join_curves = JoinCurves(Curves=deconstruct_brep.Edges, Preserve=False)
curve_3 = Curve(flatten([join_curves, circle_cnr_2]))
crv = Curve(curve_3)

# ----
# Roof Thickness
number_slider_8 = Slider(2, range=0..10)

# ---- group: Make Trimmed Surfaces
boundary = BoundarySurfaces(Edges=crv)  # -> graft(Surfaces)

# ---- group: Get the Edges/Polylines
edges = BrepEdges(Brep=boundary)  # -> Naked, Interior, NonManifold

# ----
join_curves_2 = JoinCurves(Curves=edges.Naked, Preserve=False)

# ----
# Number Of Purlins
number_slider_9 = Slider(200, range=0..200)

addition = Addition(A=number_slider_8, B=".1")
list_item_3 = ListItem(List=join_curves_2, Index="0", Wrap=True)
list_item_4 = ListItem(List=join_curves_2, Index="1", Wrap=True)
area = Area(Geometry=list_item_3)  # -> Area, Centroid
divide_curve_2 = DivideCurve(Curve=list_item_3, Count=number_slider_9, Kinks=False)  # -> Points, Tangents, Parameters
line_2 = Line(StartPoint=area.Centroid, EndPoint=divide_curve_2.Points)
extend_curve = ExtendCurve(Curve=line_2, Type=0, Start=Slider(49, range=0..100), End="0")
project_2 = Project(Curve=extend_curve, Brep=boundary, Direction=Vector(0, 0, 1))

# ----
# Column Rings
curve_4 = Curve(circle_cnr)

custom_preview = CustomPreview(Geometry=curve_4, Material=ColourSwatch(SwatchColor=RGBA(0, 0, 0, 31)))

# ----
# Roof Purlins
curve_5 = Curve(project_2)

custom_preview_2 = CustomPreview(Geometry=curve_5, Material=ColourSwatch(SwatchColor=RGBA(0, 0, 0, 31)))

# ----
# This is a gymnastic way of creating the perimier offset,
# 
# There is a better way to do this
number_slider_10 = Slider(4, range=0..10)
addition_2 = Addition(A=number_slider_3, B=number_slider_10)
addition_3 = Addition(A=number_slider_2, B=Slider(4, range=0..10))
rectangular_2 = Rectangular(Plane=xy_plane, SizeX=number_slider, SizeY=number_slider, ExtentX=addition_3, ExtentY=addition_2)  # -> Cells, Points

division_3 = Division(A=number_slider_10, B="-2")
multiplication_5 = Multiplication(A=division_3, B=number_slider)
unit_x = UnitX(Factor=multiplication_5)
unit_y = UnitY(Factor=multiplication_5)

move = Move(Geometry=rectangular_2.Cells, Motion=unit_y)  # -> Geometry, Transform
move_2 = Move(Geometry=rectangular_2.Points, Motion=unit_y)  # -> Geometry, Transform
move_3 = Move(Geometry=move_2.Geometry, Motion=unit_x)  # -> Geometry, Transform
move_4 = Move(Geometry=move.Geometry, Motion=unit_x)  # -> Geometry, Transform

# ----
# Create Roof Web
point_2 = Point(move_3.Geometry)
unit_z_2 = UnitZ(Factor=number_slider_8)
move_5 = Move(Geometry=point_2, Motion=unit_z_2)  # -> Geometry, Transform
panel_2 = Panel("""True
False""")
panel_3 = Panel("""False
True""")
cull_pattern = CullPattern(List=move_5.Geometry, CullPattern=panel_3)
cull_pattern_2 = CullPattern(List=point_2, CullPattern=panel_2)
shift_list = ShiftList(List=cull_pattern_2, Shift="1", Wrap="False")
line_3 = Line(StartPoint=shift_list, EndPoint=cull_pattern)
line_4 = Line(StartPoint=cull_pattern_2, EndPoint=cull_pattern)

# ----
# Create Roof Portal Frame
point_3 = Point(move_3.Geometry)
unit_z_3 = UnitZ(Factor=number_slider_8)
move_6 = Move(Geometry=point_3, Motion=unit_z_3)  # -> Geometry, Transform
list_length_4 = ListLength(List=move_6.Geometry)
subtraction = Subtraction(A=list_length_4, B="1")
list_item_5 = ListItem(List=point_3, Index="0", Wrap=True)
list_item_6 = ListItem(List=move_6.Geometry, Index=subtraction, Wrap=True)
list_item_7 = ListItem(List=move_6.Geometry, Index="0", Wrap=True)
list_item_8 = ListItem(List=point_3, Index=subtraction, Wrap=True)
line_5 = Line(StartPoint=list_item_5, EndPoint=list_item_7)
line_6 = Line(StartPoint=list_item_7, EndPoint=list_item_6)
line_7 = Line(StartPoint=list_item_8, EndPoint=list_item_6)
line_8 = Line(StartPoint=list_item_5, EndPoint=list_item_8)
join_curves_3 = JoinCurves(Curves=[line_5, line_6, line_7, line_8], Preserve=False)

# ----
# Create Roof Panel
curve_6 = Curve(move_4.Geometry)
unit_z_4 = UnitZ(Factor=addition)
move_7 = Move(Geometry=curve_6, Motion=unit_z_4)  # -> Geometry, Transform
boundary_surfaces = BoundarySurfaces(Edges=move_7.Geometry)

curve_7 = Curve(move_4.Geometry)

# ----
# Main Frame
curve_8 = Curve(join_curves_3)

custom_preview_3 = CustomPreview(Geometry=curve_8, Material=ColourSwatch(SwatchColor=RGBA(0, 0, 0, 31)))

# ----
# Roof Panel
brep = Brep(boundary_surfaces)

custom_preview_4 = CustomPreview(Geometry=brep, Material=ColourSwatch(SwatchColor=RGBA(255, 255, 255, 31)))

custom_preview_5 = CustomPreview(Geometry=curve_7, Material=ColourSwatch(SwatchColor=RGBA(0, 0, 0, 31)))

# ----
# Bottom Web
brep_2 = Brep(curve_7)

# ----
# Roof Webb
curve_9 = Curve([line_3, line_4])

custom_preview_6 = CustomPreview(Geometry=curve_9, Material=ColourSwatch(SwatchColor=RGBA(0, 0, 0, 31)))

# ----
# Create Column Purlins
curve_10 = Curve(circle_cnr)
divide_curve_3 = DivideCurve(Curve=curve_10, Count=number_slider_9, Kinks=False)  # -> Points, Tangents, Parameters

# ----
# This is a trick to flip matrix
# inside of a tree branch
path_mapper = PathMapper(divide_curve_3.Points, source="{A;B;C;D;E;F}(i)", target="{A;B;C;D;E;i}(F)")
param_viewer = ParamViewer(divide_curve_3.Points)

polyline = PolyLine(Vertices=path_mapper, Closed=False)

# ----
# Column Purlins
curve_11 = Curve(polyline)

custom_preview_7 = CustomPreview(Geometry=curve_11, Material=ColourSwatch(SwatchColor=RGBA(0, 0, 0, 31)))

# ----
# Preview Only, Disable for better performance
explode_2 = Explode(Curve=curve_11, Recursive=True)  # -> Segments, Vertices; disabled
explode_3 = Explode(Curve=curve_11, Recursive=True)  # -> Segments, Vertices; disabled
number_slider_11 = Slider(0.1, range=0..0.1)  # disabled
number_slider_12 = Slider(0.1, range=0..0.1)  # disabled
flatten_tree = FlattenTree(Tree=[curve_8, curve_9], Path="{0}")  # disabled
number_slider_13 = Slider(0.1, range=0..0.1)  # disabled
number_slider_14 = Slider(0.1, range=0..0.1)  # disabled
flatten_tree_2 = FlattenTree(Tree=explode_2.Segments, Path="{0}")  # disabled
flatten_tree_3 = FlattenTree(Tree=explode_3.Segments, Path="{0}")  # disabled
flatten_tree_4 = FlattenTree(Tree=curve_5, Path="{0}")  # disabled
pipe = Pipe(Curve=flatten_tree, Radius=number_slider_11, Caps=0)  # disabled
pipe_2 = Pipe(Curve=flatten_tree_4, Radius=number_slider_12, Caps=0)  # disabled
colour_swatch = ColourSwatch(SwatchColor=RGBA(0, 0, 0, 31))  # disabled
pipe_3 = Pipe(Curve=flatten_tree_2, Radius=number_slider_13, Caps=0)  # disabled
pipe_4 = Pipe(Curve=flatten_tree_3, Radius=number_slider_14, Caps=0)  # disabled
custom_preview_8 = CustomPreview(Geometry=pipe_2, Material=colour_swatch)  # disabled
custom_preview_9 = CustomPreview(Geometry=pipe_4, Material=colour_swatch)  # disabled
custom_preview_10 = CustomPreview(Geometry=pipe_3, Material=colour_swatch)  # disabled
custom_preview_11 = CustomPreview(Geometry=pipe, Material=colour_swatch)  # disabled
