# Grasshopper definition LaserCut.gh (Grasshopper 1.0.8)
# plug-ins: Human, Bifocals

mesh = Mesh(<mesh referenced from the Rhino model>)

# ----
# This changes the resolution of the new mesh
number_slider = Slider(200, range=0..1000)

# ----
# 01 - Rebuild Mesh
mesh_2 = Mesh(mesh)
bounding_box = BoundingBox(Content=mesh_2, Plane=PlaneXY(0, 0, 0))  # -> Box, Box_2
deconstruct_brep = DeconstructBrep(Brep=bounding_box.Box)  # -> Faces, Edges, Vertices
list_item = ListItem(List=deconstruct_brep.Faces, Index="4", Wrap=True)
surface_frames = SurfaceFrames(Surface=list_item, UCount=Slider(300, range=0..1000), VCount=number_slider)  # -> Frames, Parameters
unit_z = UnitZ(Factor=1)
point = Point(flatten(surface_frames.Frames))
project_point = ProjectPoint(Point=point, Direction=unit_z, Geometry=mesh_2)  # -> Point, Index
delaunay_mesh = DelaunayMesh(Points=project_point.Point, Plane=PlaneXY(0, 0, 0))
mesh_3 = Mesh(delaunay_mesh)

# ----
# This is how much of the edges will be trimmed off of the rebuilt mesh. for most cases 0.98 should work.
# 
# Reducing this value trims more of the edege off.
number_slider_2 = Slider(0.98, range=0..1)

# ----
# 02 - Trim Mesh Edges
mesh_4 = Mesh(mesh_3)
bounding_box_2 = BoundingBox(Content=mesh_4, Plane=PlaneXY(0, 0, 0))  # -> Box, Box_2
mesh_edges = MeshEdges(Mesh=mesh_4)  # -> NakedEdges, InteriorEdges, NonManifoldEdges
area = Area(Geometry=bounding_box_2.Box)  # -> Area, Centroid
scale_nu = ScaleNU(Geometry=bounding_box_2.Box, Plane=area.Centroid, ScaleX=Slider(0.98, range=0..1), ScaleY=number_slider_2, ScaleZ=1)  # -> Geometry, Transform
curve = Curve(mesh_edges.NakedEdges)
deconstruct_brep_2 = DeconstructBrep(Brep=scale_nu.Geometry)  # -> Faces, Edges, Vertices
list_item_2 = ListItem(List=deconstruct_brep_2.Faces, Index=0, Wrap=True)  # -> Item, Item1, Item2, Item3
brep = Brep([list_item_2.Item, list_item_2.Item1, list_item_2.Item2, list_item_2.Item3])
simple_mesh = SimpleMesh(Brep=brep)
mesh_join = MeshJoin(Meshes=simple_mesh)
# Flip between which Mesh is trimmed and the trimmings
number_slider_3 = Slider(1, range=0..1)
mesh_split = MeshSplit(Mesh=mesh_4, Splitters=mesh_join)
list_item_3 = ListItem(List=mesh_split, Index=number_slider_3, Wrap=True)
mesh_5 = Mesh(list_item_3)

# ----
# 03 - Create Mesh Sides
mesh_6 = Mesh(mesh_5)
mesh_edges_2 = MeshEdges(Mesh=mesh_6)  # -> NakedEdges, InteriorEdges, NonManifoldEdges
bounding_box_3 = BoundingBox(Content=mesh_6, Plane=PlaneXY(0, 0, 0))  # -> Box, Box_2
evaluate_box = EvaluateBox(Box=bounding_box_3.Box, UParameter=0.5, VParameter=0.5, WParameter="0")  # -> Plane, Point, Include
project = Project(Geometry=mesh_edges_2.NakedEdges, Plane=evaluate_box.Plane)  # -> Geometry, Transform
ruled_surface = RuledSurface(CurveA=mesh_edges_2.NakedEdges, CurveB=project.Geometry)
brep_join = BrepJoin(Breps=ruled_surface)  # -> Breps, Closed
simple_mesh_2 = SimpleMesh(Brep=brep_join.Breps)
mesh_join_2 = MeshJoin(Meshes=flatten([simple_mesh_2, mesh_6]))
mesh_7 = Mesh(mesh_join_2)

# ----
# 04 - Scale
mesh_8 = Mesh(mesh_7)
division = Division(A="1", B="64")
scale = Scale(Geometry=mesh_8, Center=Point(0, 0, 0), Factor=division)  # -> Geometry, Transform
mesh_9 = Mesh(scale.Geometry)

# ----
# 04 - Cut Resolution
number_slider_4 = Slider(0.4, range=0..1)
mesh_10 = Mesh(scale.Geometry)
triremesh = TriRemesh(Geometry=mesh_10, Length=number_slider_4, Iterations=25)  # -> Triangulation, Dual, Creases
mesh_11 = Mesh(triremesh.Triangulation)

# ----
# 06 - Contour by Material Thickness
# Material Thickness
mesh_12 = Mesh(mesh_11)
division_2 = Division(A=Slider(1, range=0..1), B=Slider(8, range=0..10))
contour = Contour(Shape=mesh_12, Point=Point(0, 0, 0), Direction=Vector(0, 0, 1), Distance=division_2)
curve_2 = Curve(contour)

# ----
# 07 - Fabrication Layout
# If we have more rectangles than contours then shorten the list to eliminate duplicates
# 
# This essentially just trims any excess from the back of the list
# Layout margin or spread
curve_3 = Curve(curve_2)
mesh_13 = Mesh(mesh_9)
tree_statistics = TreeStatistics(Tree=curve_3)  # -> Paths, Length, Count
bounding_box_4 = BoundingBox(Content=mesh_13, Plane=PlaneXY(0, 0, 0))  # -> Box, Box_2
series = Series(Start=0, Step=division_2, Count=tree_statistics.Count)
deconstruct_box = DeconstructBox(Box=bounding_box_4.Box)  # -> Plane, X, Y, Z
integer = Integer(tree_statistics.Count)
number_slider_5 = Slider(3, range=0..100)
evaluate_box_2 = EvaluateBox(Box=bounding_box_4.Box, UParameter=0.5, VParameter=0.5, WParameter="0")  # -> Plane, Point, Include
unit_z_2 = UnitZ(Factor=series)
number = Number(deconstruct_box.Y)
number_2 = Number(deconstruct_box.X)
point_2 = Point(evaluate_box_2.Plane)
square_root = SquareRoot(Value=integer)
addition = Addition(A=number, B=number_slider_5)
addition_2 = Addition(A=number_2, B=number_slider_5)
addition_3 = Addition(A=point_2, B=unit_z_2)
point_3 = Point(Point(77.55878868, 11.49904432, 0))
curve_4 = Curve(curve_3)
tstat = TreeStatistics(Tree=curve_4)  # -> Paths, Length, Count
rectangular = Rectangular(Plane=point_3, SizeX=addition_2, SizeY=addition, ExtentX=square_root, ExtentY=square_root)  # -> Cells, Points
shift = ShiftList(List=tstat.Paths, Shift="1", Wrap="False")
branch = TreeBranch(Tree=curve_4, Path=shift, MaintainPaths=False)
shortest_list = ShortestList(ListListA=flatten(addition_3), ListListB=flatten(rectangular.Points), TrimMode=2)  # -> graft(ListListA), graft(ListListB)
orient = Orient(Geometry=curve_3, Source=shortest_list.ListListA, Target=shortest_list.ListListB)  # -> Geometry, Transform
orient_2 = Orient(Geometry=branch, Source=shortest_list.ListListA, Target=shortest_list.ListListB)  # -> Geometry, Transform
project_2 = Project(Geometry=orient_2.Geometry, Plane=PlaneXY(0, 0, 0))  # -> Geometry, Transform
project_3 = Project(Geometry=orient.Geometry, Plane=PlaneXY(0, 0, 0))  # -> Geometry, Transform
curve_5 = Curve(project_3.Geometry)
curve_6 = Curve(project_2.Geometry)

# ----
# 08 - Layout Annotation
explode = Explode(Curve=curve_6, Recursive=True)  # -> simplify(Segments), Vertices
custom_preview = CustomPreview(Geometry=curve_6, Material=ColourSwatch(SwatchColor=RGB(255, 255, 0)))
custom_preview_2 = CustomPreview(Geometry=curve_5, Material=ColourSwatch(SwatchColor=RGB(0, 255, 229)))
path_mapper = PathMapper(explode.Segments, source="{A;B}", target="{A}")
end_points = EndPoints(Curve=path_mapper)  # -> Start, End
font_table = FontTable()
panel = Panel(font_table)

# ----
# Set font size based on profile area
delaunay_mesh_2 = DelaunayMesh(Points=end_points.Start, Plane=PlaneXY(0, 0, 0))
area_2 = Area(Geometry=delaunay_mesh_2)  # -> flatten(Area), Centroid
construct_domain = ConstructDomain(DomainStart=Slider(0.83, range=0..2), DomainEnd=Slider(0.14, range=0..1))
bounds = Bounds(Numbers=area_2.Area)
remap_numbers = RemapNumbers(Value=area_2.Area, Source=bounds, Target=construct_domain)  # -> reverse(Mapped), Clipped

# ----
# Get font and annotation style
panel_2 = Panel("RhSS")
# RhSS fabrication font from:
# 
# https://wiki.mcneel.com/rhino/engravingfonts
query_installed_fonts = QueryInstalledFonts(FontFamily=panel_2, FontWeight=4, FontStyle=1, FontStretch=5, Symbol=False)
model_font = ModelFont(Font=query_installed_fonts)  # -> Font, FontFamily, FontWeight, FontStyle
annotation_text_settings = AnnotationTextSettings(Font=model_font.Font, TextHeight=remap_numbers.Mapped)  # -> TextSettings, Font, TextHeight, TextGap, MaskColour, MaskMargins, MaskFrame, ViewOriented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
# Create number from elevation
tree_statistics_2 = TreeStatistics(Tree=end_points.Start)  # -> Paths, Length, Count
average = Average(Input=end_points.Start)
series_2 = Series(Start=0, Step=1, Count=tree_statistics_2.Count)
annotation_style = AnnotationStyle(Name="Fab", TextSettings=annotation_text_settings.TextSettings)  # -> AnnotationStyle, Name, ModelScale, TextSettings, DimensionSettings, ArrowSettings, UnitsSettings, LeaderSettings, ToleranceSettings
plane = Plane(average)
text_entity = TextEntity(Plane=flatten(plane), Text=series_2, Style=annotation_style.AnnotationStyle)  # -> TextEntity, Plane, Text, Style
