# Grasshopper definition RIR Part 2.gh (Grasshopper 1.0.8)
# plug-ins: Rhino.Inside for Autodesk Revit, LunchBox

mobius_surface = MobiusSurface(
    UDivisions=100,
    VDivisions=100,
    RParameter=4,
    TParameter=0.5,
    Scale=5,
    Domain1=Domain(-3.141592654, 3.141592654),
    Domain2=Domain(-1, 1))
curve = Curve([<curve referenced from the Rhino model> x5])
type = Type(<hostobjecttype referenced from the Revit model>, SelectedBuiltInCategory="autodesk.revit.category.local:walls")
level = Level(<level referenced from the Revit model>)
curve_2 = Curve([<curve referenced from the Rhino model> x3])
type_2 = Type(<hostobjecttype referenced from the Revit model>, SelectedBuiltInCategory="autodesk.revit.category.local:walls")
level_2 = Level(<level referenced from the Revit model>)
curve_3 = Curve(<curve referenced from the Rhino model>)
type_3 = Type(<hostobjecttype referenced from the Revit model>, SelectedBuiltInCategory="autodesk.revit.category.local:floors")
curve_4 = Curve(<curve referenced from the Rhino model>)
unit_z = UnitZ(Factor=Slider(6, range=0..100))
point = Point(Point(468.3215834, -36.62307554, 0))
move = Move(Geometry=mobius_surface, Motion=unit_z)  # -> Geometry, Transform
add_wall_curve = AddWallCurve(Curve=curve, Type=type, Level=level, Height=Slider(34, range=0..100), TrackingMode=2)
add_wall_curve_2 = AddWallCurve(Curve=curve_2, Type=type_2, Level=level_2, Height=Slider(100, range=0..100), TrackingMode=2)
add_floor = AddFloor(Boundary=curve_3, Type=type_3, Structural=True, TrackingMode=2)
add_railing = AddRailing(Curve=curve_4, TrackingMode=2)
mesh_sphere = MeshSphere(Base=point, Radius=Slider(55, range=0..100), UCount=10, VCount=20)
triremesh = TriRemesh(Geometry=mesh_sphere, Iterations=25)  # -> Triangulation, Dual, Creases
deconstruct_mesh = DeconstructMesh(Mesh=triremesh.Triangulation)  # -> Vertices, Faces, Colours, Normals
add_directshape_geometry = AddDirectShapeGeometry(Geometry=move.Geometry, TrackingMode=2)
face_boundaries = FaceBoundaries(Mesh=triremesh.Triangulation)
deconstruct_face = DeconstructFace(Face=deconstruct_mesh.Faces)  # -> CornerA, CornerB, CornerC, CornerD
control_points = ControlPoints(Curve=face_boundaries)  # -> Points, Weights, Knots
panel = Panel(control_points.Points)
list_item = ListItem(List=control_points.Points, Index=0, Wrap=True)  # -> Item, Item1, Item2
merge = Merge(Data1=graft(list_item.Item), Data2=graft(list_item.Item1), Data3=graft(list_item.Item2))
type_4 = Type(<familysymbol referenced from the Revit model>, SelectedBuiltInCategory="autodesk.revit.category.family:genericModel")
add_component_adaptive = AddComponentAdaptive(Points=merge, Type=type_4, TrackingMode=2)
